# Grasshopper definition 20170930_りんごのコンペのモデル1.gh (Grasshopper 0.9.76)

スパン = Panel("0.010546")
multiplication = Multiplication(A=スパン, B=Slider(0.8, range=0..1))
range = Range(Domain=Slider(58, range=0..100), Steps=Slider(5500, range=0..6000))
number_slider = Slider(1, range=0..5)
addition = Addition(A=range, B=multiplication)
expression = Expression(u=addition, v=number_slider, Expression="-15000*cos(u*v)")
panel = Panel(addition)
expression_2 = Expression(u=addition, v=number_slider, Expression="15000*sin(u*v)")
expression_3 = Expression(u=addition, v="1.4", Expression="0.0006*(u-30)^2-v")
expression_4 = Expression(u=addition, v="1.05", Expression="-0.38")
multiplication_2 = Multiplication(A=panel, B="548")
panel_2 = Panel(expression_4)
panel_3 = Panel(expression_3)
panel_4 = Panel(multiplication_2)
multiplication_3 = Multiplication(A=panel_3, B=expression)
multiplication_4 = Multiplication(A=panel_3, B=expression_2)
multiplication_5 = Multiplication(A=panel_2, B=expression)
multiplication_6 = Multiplication(A=panel_2, B=expression_2)
pt = ConstructPoint(XCoordinate=multiplication_4, YCoordinate=multiplication_3, ZCoordinate=panel_4)  # disabled
panel_5 = Panel(pt)
pt_2 = ConstructPoint(XCoordinate=multiplication_6, YCoordinate=multiplication_5, ZCoordinate=panel_4)  # disabled
panel_6 = Panel(pt_2)

number_slider_2 = Slider(1, range=0..5)
range_2 = Range(Domain=Slider(58, range=0..100), Steps=Slider(5500, range=0..6000))
expression_5 = Expression(u=range_2, v=number_slider_2, Expression="-15000*cos(u*v)")
expression_6 = Expression(u=range_2, v="1.4", Expression="0.0006*(u-30)^2-v")
expression_7 = Expression(u=range_2, v=number_slider_2, Expression="15000*sin(u*v)")
multiplication_7 = Multiplication(A=range_2, B="548")
multiplication_8 = Multiplication(A="-0.38", B=expression_7)
multiplication_9 = Multiplication(A="-0.38", B=expression_5)
multiplication_10 = Multiplication(A=expression_6, B=expression_7)
multiplication_11 = Multiplication(A=expression_6, B=expression_5)
number_slider_3 = Slider(0.008, range=0..10)
ln = Line(StartPoint="0,0,0", EndPoint="0,0,40000")
内周pt = ConstructPoint(XCoordinate=multiplication_8, YCoordinate=multiplication_9, ZCoordinate=multiplication_7)
外周pt = ConstructPoint(XCoordinate=multiplication_10, YCoordinate=multiplication_11, ZCoordinate=multiplication_7)
内周rotax = RotateAxis(Geometry=内周pt, Angle=number_slider_3, Axis=ln)  # -> Geometry, Transform; disabled
外周rotax = RotateAxis(Geometry=外周pt, Angle=number_slider_3, Axis=ln)  # -> Geometry, Transform; disabled
number_slider_4 = Slider(200, range=0..1000)  # disabled
ln_2 = Line(StartPoint=内周pt, EndPoint=内周rotax.Geometry)  # disabled
ln_3 = Line(StartPoint=外周pt, EndPoint=外周rotax.Geometry)  # disabled
ln_4 = Line(StartPoint=内周rotax.Geometry, EndPoint=外周rotax.Geometry)  # disabled
ln_5 = Line(StartPoint=内周pt, EndPoint=外周pt)  # disabled
join = JoinCurves(Curves=flatten([ln_5, ln_2, ln_3, ln_4]), Preserve=False)  # disabled
Z = UnitZ(Factor=number_slider_4)  # disabled
boundary = BoundarySurfaces(Edges=join)  # disabled
extr = Extrude(Base=boundary, Direction=Z)  # disabled
