# Grasshopper definition CV_カテナリ―アーチ_HPシェル用.gh (Grasshopper 0.9.76)

積層数 = Slider(24, range=0..100)
レンガa辺長さ = Slider(100, range=0..100)
積層n層目 = Slider(25, range=0..50)
vec = Vector(Vector(-2290.7925, -130.2659335, 0.4457311846))
レンガb辺長さ = Slider(190, range=0..200)
y_coordinate = Slider(0, range=0..100)
レンガa辺長さ_2 = Slider(100, range=0..100)
材料長さ = Slider(2950, range=0..10000)
積層n層目_2 = Slider(0, range=0..50)
レンガ厚さ = Slider(17, range=0..20)
ppバンド幅 = Slider(15.5, range=0..20)
レンガb辺長さ_2 = Slider(190, range=0..200)
材料長さ_2 = Slider(4435, range=0..10000)
レンガ厚さ_2 = Slider(17, range=0..20)
積層n層目_3 = Slider(0, range=0..50)
B = Slider(2, range=0..10)
crv = Curve([<curve referenced from the Rhino model> x2])
B_2 = Slider(2, range=0..10)
devec = DeconstructVector(Vector=vec)  # -> XComponent, YComponent, ZComponent
スパン = Slider(1720, range=0..2000)
スパン_2 = Slider(1989, range=0..2000)
panel = Panel(vec)
arrlinear = LinearArray(Direction=vec, Count=積層数)  # -> Geometry, Transform
division = Division(A=devec.XComponent, B=積層数)
division_2 = Division(A=devec.YComponent, B=積層数)
division_3 = Division(A=devec.ZComponent, B=積層数)
pt = Point(<point referenced from the Rhino model>)
pdecon = Deconstruct(Point=pt)  # -> XComponent, YComponent, ZComponent
divlength = DivideLength(Curve=crv, Length=ppバンド幅)  # -> Points, Tangents, Parameters
division_4 = Division(A=スパン, B=B)
division_5 = Division(A=スパン_2, B=B_2)
pt_2 = ConstructPoint(XCoordinate=y_coordinate, YCoordinate=y_coordinate, ZCoordinate=y_coordinate)
multiplication = Multiplication(A=レンガa辺長さ, B=積層n層目_2)
multiplication_2 = Multiplication(A=レンガa辺長さ_2, B=積層n層目_3)
multiplication_3 = Multiplication(A=積層n層目, B=division_3)
multiplication_4 = Multiplication(A=積層n層目, B=division)
multiplication_5 = Multiplication(A=積層n層目, B=division_2)
pdecon_2 = Deconstruct(Point=pt)  # -> XComponent, YComponent, ZComponent
addition = Addition(A=pdecon_2.YComponent, B=division_4)
Z = UnitZ(Factor=1)
Z_2 = UnitZ(Factor=1)
panel_2 = Panel(divlength.Points)
subtraction = Subtraction(A=addition, B=レンガ厚さ)
addition_2 = Addition(A=pdecon.XComponent, B=multiplication_4)
addition_3 = Addition(A=pdecon.YComponent, B=multiplication_5)
addition_4 = Addition(A=pdecon_2.YComponent, B=スパン)
subtraction_2 = Subtraction(A=pdecon_2.XComponent, B=multiplication)
addition_5 = Addition(A=pdecon.ZComponent, B=multiplication_3)
vec_2 = VectorXYZ(XComponent=division, YComponent=division_2, ZComponent=division_3)  # -> Vector, Length
subtraction_3 = Subtraction(A=addition_4, B=レンガ厚さ)
pt_3 = ConstructPoint(XCoordinate=division_4, YCoordinate=subtraction, ZCoordinate=スパン)
pt_4 = ConstructPoint(XCoordinate=addition_2, YCoordinate=addition_3, ZCoordinate=addition_5)
pdecon_3 = Deconstruct(Point=pt_4)  # -> XComponent, YComponent, ZComponent
addition_6 = Addition(A=pdecon_3.YComponent, B=division_5)
subtraction_4 = Subtraction(A=addition_6, B=レンガ厚さ_2)
addition_7 = Addition(A=pdecon_3.YComponent, B=スパン_2)
subtraction_5 = Subtraction(A=pdecon_3.XComponent, B=multiplication_2)
subtraction_6 = Subtraction(A=addition_7, B=レンガ厚さ_2)
pt_5 = ConstructPoint(XCoordinate=division_5, YCoordinate=subtraction_4, ZCoordinate=スパン_2)
pt_6 = ConstructPoint(XCoordinate=subtraction_2, YCoordinate=subtraction_3, ZCoordinate=pdecon_2.ZComponent)
pt_7 = ConstructPoint(XCoordinate=subtraction_5, YCoordinate=subtraction_6, ZCoordinate=pdecon_3.ZComponent)
panel_3 = Panel(pt_4)
panel_4 = Panel(division)
cat = Catenary(PointA=pt, PointB=pt_6, Length=材料長さ, Gravity=Z)
crv_cp = CurveClosestPoint(Point=pt_3, Curve=cat)  # -> Point, Parameter, Distance
pdecon_4 = Deconstruct(Point=crv_cp.Point)  # -> XComponent, YComponent, ZComponent
cat_2 = Catenary(PointA=pt_4, PointB=pt_7, Length=材料長さ_2, Gravity=Z_2)
crv_cp_2 = CurveClosestPoint(Point=pt_5, Curve=cat_2)  # -> Point, Parameter, Distance
pdecon_5 = Deconstruct(Point=crv_cp_2.Point)  # -> XComponent, YComponent, ZComponent
subtraction_7 = Subtraction(A=pdecon_4.ZComponent, B=pdecon_2.ZComponent)
subtraction_8 = Subtraction(A=pdecon_5.ZComponent, B=pdecon_3.ZComponent)
アーチ頂部高さ = Panel(subtraction_7)
アーチ頂部高さ_2 = Panel(subtraction_8)
arrcurve = CurveArray(Count=10)  # -> Geometry, Transform
divide = DivideCurve(Count=10, Kinks=False)  # -> Points, Tangents, Parameters
