# Grasshopper definition CV_カテナリ―アーチ_一方向アーチ用.gh (Grasshopper 0.9.76)
# S130H296, S260H296
# S130H592, S260H592

角材斜材長さ = Slider(1000, range=1..1130)  # disabled
角材あてがう長さ = Slider(200, range=1..1130)  # disabled
角材土台長さ = Slider(1045, range=1..1130)  # disabled
角材柱長さ = Slider(1000, range=1..1130)  # disabled
y_coordinate = Slider(0, range=0..100)
角材柱断面b辺 = Slider(46, range=1..50)  # disabled
角材桁高さ = Slider(661, range=1..1130)  # disabled
角材桁長さ = Slider(1000, range=1..1130)  # disabled
角材小さいの_土台_角度 = Slider(45, range=0..90)  # disabled
角材柱断面a辺 = Slider(46, range=1..50)  # disabled
角材小さいの_桁_角度 = Slider(45, range=0..90)  # disabled
スパンの中点用 = Slider(2, range=0..10)
材料長さ = Slider(1301, range=0..10000)
レンガ厚さ = Slider(17, range=0..20)
レンガa辺長さ = Slider(90, range=0..100)
レンガb辺長さ = Slider(190, range=0..200)
レンガ間隔補正値 = Slider(1.098, range=0.9..2.6)
スパン = Slider(1130, range=0..2260)
ppメッシュの間隔 = Slider(30, range=0..50)
レンガの角度 = Slider(0.257, range=0..1)
ppの幅 = Slider(15, range=0..20)
pp湶の角度 = Slider(0.27, range=0..1)
ppの厚さ = Slider(0.29, range=0..0.5)
目地の厚さ = Slider(10, range=3..15)
角材断面a辺 = Slider(46, range=1..50)  # disabled
角材断面b辺 = Slider(23, range=1..50)  # disabled

# ---- group: モデリングの基準点
pt = Point("0,0,0")

# ----
積層n層目 = Slider(0, range=0..50)

# ---- group: 幅の補正
expression = Expression(x=レンガb辺長さ, y=角材断面b辺, Expression="x/2-y/2")  # disabled

# ----
pi = Pi(Factor=1)
pi_2 = Pi(Factor=1)
multiplication = Multiplication(A=pi, B=pp湶の角度)
division = Division(A=スパン, B=スパンの中点用)
expression_2 = Expression(x=division, y=角材土台長さ, z=角材柱断面b辺, Expression="y/2-z/2")  # disabled

# ---- group: スパン方向の補正
expression_3 = Expression(x=division, y=角材土台長さ, Expression="x-y/2")  # disabled
expression_4 = Expression(x=division, y=角材土台長さ, Expression="x+y/2")  # disabled

# ----
expression_5 = Expression(x=division, y=角材桁長さ, Expression="x-y/2")  # disabled
expression_6 = Expression(x=division, y=角材桁長さ, Expression="x+y/2")  # disabled

multiplication_2 = Multiplication(A=pi_2, B=レンガの角度)
rad = Radians(Degrees=角材小さいの_桁_角度)  # disabled
rad_2 = Radians(Degrees=角材小さいの_土台_角度)  # disabled
neg = Negative(Value=ppの厚さ)
pt_2 = ConstructPoint(XCoordinate=y_coordinate, YCoordinate=y_coordinate, ZCoordinate=y_coordinate)

# ---- group: PPを作る為
pt_3 = ConstructPoint(XCoordinate=レンガb辺長さ, YCoordinate=ppの幅, ZCoordinate=ppの厚さ)

# ----
pdecon = Deconstruct(Point=pt)  # -> XComponent, YComponent, ZComponent
vec = VectorXYZ(XComponent=expression, YComponent=expression_3, ZComponent=0)  # -> Vector, Length; disabled
addition = Addition(A=pdecon.YComponent, B=division)
vec_2 = VectorXYZ(XComponent=expression, YComponent=expression_4, ZComponent=0)  # -> Vector, Length; disabled
vec_3 = VectorXYZ(XComponent=expression, YComponent=expression_5, ZComponent=角材桁高さ)  # -> Vector, Length; disabled
vec_4 = VectorXYZ(XComponent=expression, YComponent=expression_6, ZComponent=角材桁高さ)  # -> Vector, Length; disabled
vec_5 = VectorXYZ(XComponent=0, YComponent=expression_2, ZComponent=0)  # -> Vector, Length; disabled

# ---- group: 下端PP湶
box = Box2Pt(PointA=pt, PointB=pt_3, Plane=PlaneXY(0, 0, 0))

# ----
addition_2 = Addition(A=pdecon.YComponent, B=スパン)
pt_4 = ConstructPoint(XCoordinate=レンガb辺長さ, YCoordinate=レンガa辺長さ, ZCoordinate=レンガ厚さ)
move = Move(Geometry=pt, Motion=vec.Vector)  # -> Geometry, Transform; disabled
move_2 = Move(Geometry=pt, Motion=vec_2.Vector)  # -> Geometry, Transform; disabled
subtraction = Subtraction(A=addition, B=レンガ厚さ)
neg_2 = Negative(Value=rad)  # disabled
neg_3 = Negative(Value=rad_2)  # disabled
move_3 = Move(Geometry=pt, Motion=vec_3.Vector)  # -> Geometry, Transform; disabled
move_4 = Move(Geometry=pt, Motion=vec_4.Vector)  # -> Geometry, Transform; disabled

# ---- group: 下端PP湶から作製された上端PP湶
addition_3 = Addition(A=レンガ厚さ, B=レンガ厚さ, C=目地の厚さ)
vec_6 = VectorXYZ(XComponent=0, YComponent=0, ZComponent=addition_3)  # -> Vector, Length
move_5 = Move(Geometry=box, Motion=vec_6.Vector)  # -> Geometry, Transform

# ---- group: PPを作る為
pt_5 = ConstructPoint(XCoordinate=neg, YCoordinate=ppの幅, ZCoordinate=addition_3)

# ---- group: PP側面1
box_2 = Box2Pt(PointA=pt, PointB=pt_5, Plane=PlaneXY(0, 0, 0))

# ----
move_6 = Move(Geometry=move.Geometry, Motion=vec_5.Vector)  # -> Geometry, Transform; disabled
addition_4 = Addition(A=レンガb辺長さ, B=ppの厚さ)
Z = UnitZ(Factor=1)  # disabled

# ---- group: レンガ
box_3 = Box2Pt(PointA=pt, PointB=pt_4, Plane=PlaneXY(0, 0, 0))

# ----
subtraction_2 = Subtraction(A=addition_2, B=レンガ厚さ)
pt_6 = ConstructPoint(XCoordinate=pdecon.XComponent, YCoordinate=subtraction, ZCoordinate=材料長さ)
vec_7 = VectorXYZ(XComponent=ppの幅, YComponent=0, ZComponent=0)  # -> Vector, Length
vec_8 = VectorXYZ(XComponent=角材断面a辺, YComponent=0, ZComponent=0)  # -> Vector, Length; disabled
ln = Line(StartPoint=move.Geometry, EndPoint=move_2.Geometry)  # disabled
vec_9 = VectorXYZ(XComponent=角材断面a辺, YComponent=0, ZComponent=0)  # -> Vector, Length; disabled
ln_2 = Line(StartPoint=move_3.Geometry, EndPoint=move_4.Geometry)  # disabled
line = LineSDL(Start=move_6.Geometry, Direction=Z, Length=角材柱長さ)  # disabled
cos = Panel()
原点 = Panel()
sin = Panel()
X = UnitX(Factor=1)
addition_5 = Addition(A=ppの幅, B=ppメッシュの間隔)
vec_10 = VectorXYZ(XComponent=addition_4, YComponent=0, ZComponent=0)  # -> Vector, Length
上端補正値 = Slider(13, range=5..20)
division_2 = Division(A=材料長さ, B=レンガa辺長さ)

# ---- group: 2層目
レンガ間隔補正値_2 = Slider(1.03, range=0.9..1.55)
レンガの角度2層目 = Slider(0.278, range=0..1)
pi_3 = Pi(Factor=1)
multiplication_3 = Multiplication(A=pi_3, B=レンガの角度2層目)
multiplication_4 = Multiplication(A=division_2, B=レンガ間隔補正値_2)

# ----
pt_7 = ConstructPoint(XCoordinate=pdecon.XComponent, YCoordinate=subtraction_2, ZCoordinate=pdecon.ZComponent)
Z_2 = UnitZ(Factor=1)
extr = Extrude(Base=ln, Direction=vec_8.Vector)  # disabled
extr_2 = Extrude(Base=ln_2, Direction=vec_9.Vector)  # disabled
rot3d = Rotate3D(Geometry=box_3, Angle=multiplication_2, Center=pt, Axis=X)  # -> Geometry, Transform

# ---- group: PP側面2
move_7 = Move(Geometry=box_2, Motion=vec_10.Vector)  # -> Geometry, Transform

# ----
neg_4 = Negative(Value=ppの厚さ)

# ---- group: アーチ長さ/PP配置間隔
division_3 = Division(A=材料長さ, B=addition_5)

# ----
vec_11 = VectorXYZ(XComponent=0, YComponent=角材柱断面b辺, ZComponent=0)  # -> Vector, Length; disabled
Z_3 = UnitZ(Factor=1)
vec_12 = VectorXYZ(XComponent=0, YComponent=0, ZComponent=角材断面b辺)  # -> Vector, Length; disabled
extr_3 = Extrude(Base=line, Direction=vec_11.Vector)  # disabled
vec_13 = VectorXYZ(XComponent=0, YComponent=0, ZComponent=角材断面b辺)  # -> Vector, Length; disabled
multiplication_5 = Multiplication(A=division_2, B=レンガ間隔補正値)

# ---- group: レンガA辺長さ/PP配置間隔
division_4 = Division(A=レンガb辺長さ, B=addition_5)

# ----
pt_8 = ConstructPoint(XCoordinate=0, YCoordinate=cos, ZCoordinate=sin)
vec_14 = VectorXYZ(XComponent=0, YComponent=0, ZComponent=neg_4)  # -> Vector, Length
extr_4 = Extrude(Base=extr_2, Direction=vec_13.Vector)  # disabled

# ---- group: カテナリー下端
catenary = Catenary(PointA=pt, PointB=pt_7, Length=材料長さ, Gravity=Z_2)

# ---- group: 塩化ビニル波板
range = Range(Domain=レンガb辺長さ, Steps=Slider(250, range=0..500))
expression_7 = Expression(u=range, Expression="-5*sin(0.215*u)")
波板小口角度補正 = Slider(0.98, range=0..1.3)
pt_9 = ConstructPoint(XCoordinate=range, YCoordinate=pdecon.XComponent, ZCoordinate=expression_7)
nurbs = NurbsCurve(Vertices=pt_9, Degree=3, Periodic=False)  # -> Curve, Length, Domain
multiplication_6 = Multiplication(A=multiplication_2, B=波板小口角度補正)
rot3d_2 = Rotate3D(Geometry=nurbs.Curve, Angle=multiplication_6, Center=Point(0, 0, 0), Axis=X)  # -> Geometry, Transform
swp1 = Sweep1(Rail=catenary, Sections=rot3d_2.Geometry, Miter=1)  # disabled
move_8 = Move(Geometry=swp1, Motion=Vector(0, 2, -12))  # -> Geometry, Transform

# ----
crv_cp = CurveClosestPoint(Point=pt_6, Curve=catenary)  # -> Point, Parameter, Distance
pdecon_2 = Deconstruct(Point=crv_cp.Point)  # -> XComponent, YComponent, ZComponent

# ---- group: 小数点以下切り捨て
vb = VBScript(x=division_3)  # -> out, PPabara
# ---------- vb: C# ----------
    PPabara = Integer.Parse(math.Floor(x))
# ---------- end vb ----------

# ----
panel = Panel("2")  # disabled

# ---- group: 角材土台
extr_5 = Extrude(Base=extr, Direction=vec_12.Vector)  # disabled
arrlinear = LinearArray(Geometry=extr_5, Direction=vec_12.Vector, Count=panel)  # -> Geometry, Transform; disabled

# ----
vec_15 = VectorXYZ(XComponent=角材柱断面a辺, YComponent=0, ZComponent=0)  # -> Vector, Length; disabled

# ---- group: 角材柱
extr_6 = Extrude(Base=extr_3, Direction=vec_15.Vector)  # disabled

# ----
addition_6 = Addition(A=レンガ厚さ, B=目地の厚さ, C=上端補正値)

# ---- group: 1層目の点
arrcurve = CurveArray(Geometry=pt, Curve=catenary, Count=multiplication_5)  # -> Geometry, Transform

# ----
subtraction_3 = Subtraction(A=pdecon_2.ZComponent, B=pdecon.ZComponent)
下端補正値 = Slider(-5, range=-15..-5)

# ---- group: カテナリー下端
catenary_2 = Catenary(PointA=pt, PointB=pt_7, Length=材料長さ, Gravity=Z_3)

# ----
Y = UnitY(Factor=1)
vec2pt = Vector2Pt(PointA=原点, PointB=pt_8, Unitize=False)  # -> Vector, Length
kinkcrv = KinkyCurve(Degree=3, Angle=0.1745329252)  # -> Curve, Length, Domain

# ---- group: 小数点以下切り捨て
vb_2 = VBScript(x=division_4)  # -> out, PPshukin
# ---------- vb_2: C# ----------
    PPshukin = Integer.Parse(math.Floor(x))
# ---------- end vb_2 ----------

# ----
tancurve = TangentCurve(Blend=0.5, Degree=3)  # -> Curve, Length, Domain
vec_16 = VectorXYZ(XComponent=0, YComponent=0, ZComponent=角材桁高さ)  # -> Vector, Length; disabled
vb_3 = VBScript()  # -> Out, A

# ---- group: カテナリー上端
offset = Offset(Curve=catenary_2, Distance=addition_6, Plane=PlaneXY(0, 0, 0), Corners=1)

# ----
X_2 = UnitX(Factor=1)  # disabled

# ---- group: アーチの幅を掛ける
multiplication_7 = Multiplication(A=vb.PPabara, B=レンガb辺長さ)

# ----
X_3 = UnitX(Factor=1)
extr_7 = Extrude(Base=catenary_2, Direction=vec_7.Vector)

# ---- group: 角材桁
move_9 = Move(Geometry=move.Geometry, Motion=vec_16.Vector)  # -> Geometry, Transform; disabled

# ----
expression_8 = Expression(x=角材土台長さ, y=角材桁長さ, Expression="y/2-x/2")  # disabled
expression_9 = Expression(x=角材桁高さ, y=角材断面b辺, Expression="x-y/2")  # disabled
neg_5 = Negative(Value=角材断面b辺)  # disabled
angle = Angle(VectorA=Y, VectorB=vec2pt.Vector)  # -> Angle, Reflex

# ---- group: 1層目
arrcurve_2 = CurveArray(Geometry=rot3d.Geometry, Curve=catenary, Count=multiplication_5)  # -> Geometry, Transform

# ----
series = Series(Start=0, Step=addition_5, Count=vb_2.PPshukin)
アーチ頂部高さ = Panel(subtraction_3)

# ---- group: PP主筋上端
extr_8 = Extrude(Base=offset, Direction=vec_7.Vector)

# ----
line_2 = LineSDL(Start=move.Geometry, Direction=X_2, Length=レンガb辺長さ)  # disabled
vec_17 = VectorXYZ(XComponent=0, YComponent=Slider(-47, range=-50..0), ZComponent=Slider(-21, range=-30..0))  # -> Vector, Length

# ---- group: 2層目
rot3d_3 = Rotate3D(Geometry=box_3, Angle=multiplication_3, Center=pt, Axis=X)  # -> Geometry, Transform
offset_2 = Offset(Curve=catenary, Distance=レンガ厚さ, Plane=PlaneXY(0, 0, 0), Corners=1)
move_10 = Move(Geometry=rot3d_3.Geometry, Motion=vec_17.Vector)  # -> Geometry, Transform
arrcurve_3 = CurveArray(Geometry=move_10.Geometry, Curve=offset_2, Count=multiplication_4)  # -> Geometry, Transform

# ----
boxprop = BoxProperties()  # -> Center, Diagonal, Area, Volume, Degeneracy

# ---- group: 下端と上端PP湶を並列
rot3d_4 = Rotate3D(Geometry=[box, move_5.Geometry, box_2, move_7.Geometry], Angle=multiplication, Center=Point(0, 0, 0), Axis=X_3)  # -> Geometry, Transform
move_11 = Move(Geometry=rot3d_4.Geometry, Motion=Vector(0, 10, 5))  # -> Geometry, Transform
arrcurve_4 = CurveArray(Geometry=move_11.Geometry, Curve=offset_2, Count=division_3)  # -> Geometry, Transform

# ----
vec_18 = VectorXYZ(XComponent=0, YComponent=0, ZComponent=下端補正値)  # -> Vector, Length
vec_19 = VectorXYZ(XComponent=0, YComponent=neg_5, ZComponent=0)  # -> Vector, Length; disabled
cull_i = CullIndex(List=move_9.Geometry, Indices=1, Wrap=True)  # disabled
cull_i_2 = CullIndex(List=move_9.Geometry, Indices=2, Wrap=True)  # disabled
panel_2 = Panel("Manage Vector Collection")

# ---- group: アーチ下端での長さ
len = Length(Curve=offset_2)

# ----
panel_3 = Panel(angle.Angle)

# ---- group: アーチの厚さ×湶本数
multiplication_8 = Multiplication(A=addition_3, B=vb.PPabara)

# ----
pp主筋の被り厚さ的な = Slider(8, range=1..14)
extr_9 = Extrude(Base=line_2, Direction=vec_19.Vector)  # disabled

# ---- group: アーチ上端での長さ
len_2 = Length(Curve=offset)

# ----
vec_20 = VectorXYZ(XComponent=0, YComponent=expression_2, ZComponent=角材柱長さ)  # -> Vector, Length; disabled
vec_21 = VectorXYZ(XComponent=series, YComponent=0, ZComponent=0)  # -> Vector, Length
move_12 = Move(Geometry=extr_7, Motion=vec_18.Vector)  # -> Geometry, Transform
vec_22 = VectorXYZ(XComponent=0, YComponent=0, ZComponent=角材断面a辺)  # -> Vector, Length; disabled
ln_3 = Line(StartPoint=cull_i, EndPoint=cull_i_2)  # disabled
extr_10 = Extrude(Base=extr_9, Direction=vec_22.Vector)  # disabled
vec_23 = VectorXYZ(XComponent=0, YComponent=expression_8, ZComponent=expression_9)  # -> Vector, Length; disabled
move_13 = Move(Geometry=line_2, Motion=vec_20.Vector)  # -> Geometry, Transform; disabled
vec_24 = VectorXYZ(XComponent=0, YComponent=角材柱断面b辺, ZComponent=0)  # -> Vector, Length; disabled

# ---- group: PP主筋下端
extr_11 = Extrude(Base=move_12.Geometry, Direction=vec_14.Vector)

# ----
addition_7 = Addition(A=角材土台長さ, B=角材断面b辺)  # disabled
要素数 = Panel(arrcurve.Geometry)

# ---- group: 主筋の本数
lng = ListLength(List=series)

# ----
multiplication_9 = Multiplication(A=len, B=lng)
move_14 = Move(Geometry=extr_10, Motion=vec_23.Vector)  # -> Geometry, Transform; disabled
下端主筋長さ = Panel(len)
extr_12 = Extrude(Base=move_13.Geometry, Direction=vec_24.Vector)  # disabled
上端主筋本数 = Panel(vb_2.PPshukin)
vec_25 = VectorXYZ(XComponent=0, YComponent=addition_7, ZComponent=0)  # -> Vector, Length; disabled
move_15 = Move(Geometry=extr_10, Motion=vec_25.Vector)  # -> Geometry, Transform; disabled
vec_26 = VectorXYZ(XComponent=0, YComponent=0, ZComponent=角材断面b辺)  # -> Vector, Length; disabled
move_16 = Move(Geometry=move_15.Geometry, Motion=vec_23.Vector)  # -> Geometry, Transform; disabled

# ---- group: 下端と上端PP主筋を並列
move_17 = Move(Geometry=[extr_11, extr_8], Motion=vec_21.Vector)  # -> Geometry, Transform

# ----
vec_27 = VectorXYZ(XComponent=pp主筋の被り厚さ的な, YComponent=0, ZComponent=0)  # -> Vector, Length
box_4 = EvaluateBox(Box=move_14.Geometry, UParameter=0.5, VParameter=0.5, WParameter=0.5)  # -> Plane, Point, Include; disabled

# ---- group: 角材小さいの3
extr_13 = Extrude(Base=extr_12, Direction=vec_26.Vector)  # disabled

# ----
上端主筋長さ = Panel(len_2)
下端主筋本数 = Panel(上端主筋本数)
multiplication_10 = Multiplication(A=lng, B=len_2)

# ---- group: A:下端湶,B:上端湶,C:側面,D:側面,E:下端主筋,F:上端主筋
a_b_c_d_e_f = Addition(A=multiplication_7, B=multiplication_7, C=multiplication_8, D=multiplication_8, E=multiplication_9, F=multiplication_10)

# ----
必要ppバンド長さ_mm = Panel(a_b_c_d_e_f)
vec_28 = VectorXYZ(XComponent=0, YComponent=角材土台長さ, ZComponent=0)  # -> Vector, Length; disabled
move_18 = Move(Geometry=move.Geometry, Motion=vec_28.Vector)  # -> Geometry, Transform; disabled
box_5 = EvaluateBox(Box=move_16.Geometry, UParameter=0.5, VParameter=0.5, WParameter=0.5)  # -> Plane, Point, Include; disabled
move_19 = Move(Geometry=move_17.Geometry, Motion=vec_27.Vector)  # -> Geometry, Transform
湶本数 = Panel(vb.PPabara)

# ---- group: 角材小さいの1
rot3d_5 = Rotate3D(Geometry=move_15.Geometry, Angle=rad_2, Center=move_18.Geometry, Axis=Vector(1, 0, 0))  # -> Geometry, Transform; disabled
rot3d_6 = Rotate3D(Geometry=extr_10, Angle=neg_3, Center=move.Geometry, Axis=Vector(1, 0, 0))  # -> Geometry, Transform; disabled

# ----
a_b_c_d = Addition(A=レンガb辺長さ, B=レンガb辺長さ, C=addition_3, D=addition_3)
湶長さ = Panel(a_b_c_d)

# ---- group: 角材小さいの2
rot3d_7 = Rotate3D(Geometry=move_16.Geometry, Angle=rad, Center=box_5.Point, Axis=Vector(1, 0, 0))  # -> Geometry, Transform; disabled
rot3d_8 = Rotate3D(Geometry=move_14.Geometry, Angle=neg_2, Center=box_4.Point, Axis=Vector(1, 0, 0))  # -> Geometry, Transform; disabled

# ----
geo = Geometry([extr_6, arrlinear.Geometry, extr_13, rot3d_8.Geometry, rot3d_7.Geometry, rot3d_6.Geometry, rot3d_5.Geometry])  # disabled
geo_2 = Geometry([move_19.Geometry, arrcurve_4.Geometry])
addition_8 = Addition(A=Slider(25, range=0..25), B=レンガ厚さ)
end = EndPoints(Curve=offset_2)  # -> Start, End
arrcurve_5 = CurveArray(Geometry=end.Start, Curve=offset_2, Count=Slider(286, range=0..300))  # -> Geometry, Transform
要素数_2 = Panel(arrcurve_5.Geometry)
